# Grasshopper definition networkAnalysis.gh (Grasshopper 1.0.7)
# plug-ins: UrbanXTools

number_slider = Slider(6000, range=0..10000)

# ----
# 设计地块
curve = Curve([<curve referenced from the Rhino model> x527])

# ----
# 设计路网
curve_2 = Curve([<curve referenced from the Rhino model> x62])

# ----
# 路网密度计算范围
curve_3 = Curve(<curve referenced from the Rhino model>)

na_roaddensity = NA_RoadDensity(Roads=curve_2, Boundary=curve_3)  # -> RoadDensityDouble, RoadDensityString, CurvesInBoundary

# ----
# 空间句法计算模块
na_computing = NA_Computing(RoadsData=curve_2, Radius="-1")  # -> MetricChoice, MetricIntegration, MetricMeanDepth, MetricTotalDepth, AngularChoice, AngularIntegration, AngularMeanDepth, AngularTotalDepth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

panel = Panel(na_roaddensity.RoadDensityString)

# ----
# 路网可达性
data = Data(na_computing.CleanedRoadsData)
data_2 = Data(na_computing.AngularChoice)
display = Display(parameter=data_2)
curve_middle = CurveMiddle(Curve=data)
text_tag_3d = TextTag3D(Location=curve_middle, Text=data_2, Size=30, Justification=7)
custom_preview = CustomPreview(Geometry=data, Material=display)

# ----
# 地块可达性
na_clearsitesdata = NA_ClearSitesData(OriginalSitesData=curve)
na_siteaccessibility = NA_SiteAccessibility(RoadsSegments=na_computing.CleanedRoadsData, RoadsScores=data_2, SitesCurves=na_clearsitesdata)  # -> SitesPolygons, SiteScores
display_2 = Display(parameter=na_siteaccessibility.SiteScores)
boundary_surfaces = BoundarySurfaces(Edges=na_siteaccessibility.SitesPolygons)
custom_preview_2 = CustomPreview(Geometry=boundary_surfaces, Material=display_2)

# ==== cluster Display
parameter = ClusterInput()
bounds = Bounds(Numbers=parameter)
deconstruct_domain = DeconstructDomain(Domain=bounds)  # -> Start, End
gradient = Gradient(
    LowerLimit=deconstruct_domain.Start,
    UpperLimit=deconstruct_domain.End,
    Parameter=parameter,
    stops=[0: RGB(0, 128, 0), 0.528: RGB(255, 255, 0), 1: RGB(255, 0, 0)])
colour = ClusterOutput(gradient)
panel = Panel(gradient)
