# Grasshopper definition resoucesDemand.gh (Grasshopper 1.0.7)
# plug-ins: UrbanXTools

# ----
# 设计路网
curve = Curve([<curve referenced from the Rhino model> x88])

# ----
# 设计地块（多地块）
# 注意：需保证地块顺序与参数顺序一致
curve_2 = Curve([<curve referenced from the Rhino model> x3])

# ----
# 地块建筑形态
非住宅建筑形态类型 = ValueList({"单点式": 0, "围合式": 1, "混合式": 2}, selected="混合式")
住宅建筑形态类型 = ValueList({"行列式": 0, "单点式": 1}, selected="行列式")
# 注意：目前工业和仓储用地建筑只有单点式风格
非住宅建筑形态类型_2 = ValueList({"单点式": 0, "围合式": 1, "混合式": 2}, selected="单点式")

# ----
# 建筑朝向
gene_pool = GenePool(Decimals=3, Maximum=1, Minimum=-1, Value=[0.027, 0.005, 0.32])

# ----
# 地块类型
用地类型_深标 = ValueList({"居住用地R": 0, "商业用地C": 1, "公共管理用地GIC": 2, "仓储用地": 3, "工业用地": 4}, selected="仓储用地")
用地类型_深标_2 = ValueList({"居住用地R": 0, "商业用地C": 1, "公共管理用地GIC": 2, "仓储用地": 3, "工业用地": 4}, selected="商业用地C")
用地类型_深标_3 = ValueList({"居住用地R": 0, "商业用地C": 1, "公共管理用地GIC": 2, "仓储用地": 3, "工业用地": 4}, selected="居住用地R")
merge = Merge(Data1=用地类型_深标_2, Data2=用地类型_深标_3, Data3=用地类型_深标)

# ----
# 地块目标容积率
gene_pool_2 = GenePool(Decimals=3, Maximum=10, Minimum=0, Value=[4.492, 2.408, 1.446])

# ----
# 地块目标建筑密度
gene_pool_3 = GenePool(Decimals=3, Maximum=1, Minimum=0, Value=[0.381, 0.421, 0.275])

# ----
# 地块目标功能混合率
gene_pool_4 = GenePool(Decimals=3, Maximum=1, Minimum=0, Value=[0.19, 0.205, 0.275])

# ----
# 所属城市
value_list = ValueList({"北京": 0, "上海": 1, "天津": 2, "深圳": 3}, selected="北京")

# ----
# 路网可达性计算
na_clearroadsdata = NA_ClearRoadsData(OriginalRoadsData=curve)
na_computing = NA_Computing(Roads=na_clearroadsdata, Radius=Slider(6000, range=0..10000), Normalise=Toggle(True))  # -> Metric_Betweenness, Metric_Closeness, Angular_Betweenness, Angular_Closeness
data = Data(na_computing.Metric_Closeness)
display = Display(parameter=data)
custom_preview = CustomPreview(Geometry=na_clearroadsdata, Material=display)

merge_2 = Merge(Data1=非住宅建筑形态类型, Data2=住宅建筑形态类型, Data3=非住宅建筑形态类型_2)
sa_exposurerate = SA_ExposureRate(Nomalized=True, Radius=500, Segments=20)  # -> OutputLines, OutputExposureRates

# ----
# 1_计算地块初始参数
ud_siteparameter = UD_SiteParameter(AllRoads=na_clearroadsdata, AllScores=data, AllSites=curve_2)

# ----
# 2_设定地块目标参数
ud_siteparameterextra = UD_SiteParameterExtra(
    SiteParameters=ud_siteparameter,
    SiteTypes=merge,
    SiteFARs=gene_pool_2,
    Densities=gene_pool_3,
    MixRatios=gene_pool_4,
    BuidlingStyles=merge_2,
    MainOritation=gene_pool)

# ----
# 3_生成地块建筑方案
ud_sitegenerateplans = UD_SiteGeneratePlans(SiteParameters=ud_siteparameterextra, CityIndex=value_list)  # -> SiteResults, Sites, FARs, Densities, SubSites, SubSitesSetbacks, BuildingLayers, BuildingRoofs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

panel = Panel(ud_sitegenerateplans.FARs)
panel_2 = Panel(ud_sitegenerateplans.Densities)

# ----
# 4_资源荷载量计算
rd_energy = RD_Energy(DesignResult=ud_sitegenerateplans.SiteResults)
rd_waste = RD_Waste(DesignResult=ud_sitegenerateplans.SiteResults)
rd_water = RD_Water(DesignResult=ud_sitegenerateplans.SiteResults)
panel_3 = Panel(rd_energy)
energydisplay = EnergyDisplay(domain=rd_energy)
wastedisplay = WasteDisplay(domain=rd_waste)
waterdisplay = WaterDisplay(domain=rd_water)
custom_preview_2 = CustomPreview(Geometry=flatten(ud_sitegenerateplans.BuildingBreps), Material=energydisplay)
custom_preview_3 = CustomPreview(Geometry=flatten(ud_sitegenerateplans.BuildingBreps), Material=wastedisplay)
custom_preview_4 = CustomPreview(Geometry=flatten(ud_sitegenerateplans.BuildingBreps), Material=waterdisplay)

rd_population = RD_Population(InputBreps=ud_sitegenerateplans.BuildingBreps)
panel_4 = Panel(rd_population)

# ----
# 显示设定
colour_swatch = ColourSwatch(SwatchColor=RGB(141, 171, 82))
boundary_surfaces = BoundarySurfaces(Edges=ud_sitegenerateplans.SubSitesSetbacks)
boundary_surfaces_2 = BoundarySurfaces(Edges=ud_sitegenerateplans.SubSites)
extrude = Extrude(Base=boundary_surfaces_2, Direction="0,0,0.15")
extrude_2 = Extrude(Base=boundary_surfaces, Direction=expr("x*2", "0,0,0.15"))
area = Area(Geometry=ud_sitegenerateplans.BuildingRoofs)  # -> Area, Centroid
colour_swatch_2 = ColourSwatch(SwatchColor=RGB(102, 102, 102))
custom_preview_5 = CustomPreview(Geometry=ud_sitegenerateplans.BuildingBreps, Material=ColourSwatch(SwatchColor=RGBA(255, 255, 255, 145)))
text_tag_3d = TextTag3D(
    Location=area.Centroid,
    Text=ud_sitegenerateplans.BuildingFloors,
    Size=Slider(5, range=0..10),
    Colour=ColourSwatch(SwatchColor=RGB(0, 0, 0)),
    Justification=7)
custom_preview_6 = CustomPreview(Geometry=ud_sitegenerateplans.BuildingLayers, Material=colour_swatch_2)
custom_preview_7 = CustomPreview(Geometry=extrude_2, Material=colour_swatch)
custom_preview_8 = CustomPreview(Geometry=extrude, Material=ColourSwatch(SwatchColor=RGB(194, 194, 194)))

populationdisplay = PopulationDisplay(data=rd_population)
custom_preview_9 = CustomPreview(Geometry=ud_sitegenerateplans.BuildingRoofs, Material=colour_swatch_2)
custom_preview_10 = CustomPreview(Geometry=flatten(ud_sitegenerateplans.BuildingBreps), Material=populationdisplay)

# ==== cluster Display
parameter = ClusterInput()
bounds = Bounds(Numbers=parameter)
deconstruct_domain = DeconstructDomain(Domain=bounds)  # -> Start, End
gradient = Gradient(
    LowerLimit=deconstruct_domain.Start,
    UpperLimit=deconstruct_domain.End,
    Parameter=parameter,
    stops=[0: RGB(0, 128, 0), 0.528: RGB(255, 255, 0), 1: RGB(255, 0, 0)])
colour = ClusterOutput(gradient)

# ==== cluster EnergyDisplay
domain = ClusterInput()
deconstruct_domain = DeconstructDomain(Domain=domain)  # -> Start, End
data = Data(flatten(deconstruct_domain.End))
bounds = Bounds(Numbers=data)
deconstruct_domain_2 = DeconstructDomain(Domain=bounds)  # -> Start, End
gradient = Gradient(
    LowerLimit=deconstruct_domain_2.Start,
    UpperLimit=deconstruct_domain_2.End,
    Parameter=data,
    stops=[0.162: RGBA(252, 174, 174, 180), 0.751: RGBA(191, 0, 0, 188)])
colour = ClusterOutput(gradient)

# ==== cluster WasteDisplay
domain = ClusterInput()
deconstruct_domain = DeconstructDomain(Domain=domain)  # -> Start, End
data = Data(flatten(deconstruct_domain.End))
bounds = Bounds(Numbers=data)
deconstruct_domain_2 = DeconstructDomain(Domain=bounds)  # -> Start, End
gradient = Gradient(
    LowerLimit=deconstruct_domain_2.Start,
    UpperLimit=deconstruct_domain_2.End,
    Parameter=data,
    stops=[0.174: RGBA(134, 135, 194, 180), 0.81: RGBA(34, 0, 115, 188)])
colour = ClusterOutput(gradient)

# ==== cluster WaterDisplay
domain = ClusterInput()
deconstruct_domain = DeconstructDomain(Domain=domain)  # -> Start, End
data = Data(flatten(deconstruct_domain.End))
bounds = Bounds(Numbers=data)
deconstruct_domain_2 = DeconstructDomain(Domain=bounds)  # -> Start, End
gradient = Gradient(
    LowerLimit=deconstruct_domain_2.Start,
    UpperLimit=deconstruct_domain_2.End,
    Parameter=data,
    stops=[0.195: RGBA(134, 166, 194, 180), 0.77: RGBA(19, 115, 189, 188)])
colour = ClusterOutput(gradient)

# ==== cluster PopulationDisplay
data = ClusterInput()
data_2 = Data(flatten(data))
bounds = Bounds(Numbers=data_2)
deconstruct_domain = DeconstructDomain(Domain=bounds)  # -> Start, End
gradient = Gradient(
    LowerLimit=deconstruct_domain.Start,
    UpperLimit=deconstruct_domain.End,
    Parameter=data_2,
    stops=[0.1: RGB(234, 38, 0), 0.5: RGB(254, 244, 84), 0.876: RGB(75, 107, 169)])
colour = ClusterOutput(gradient)
