# Grasshopper definition ExposureRates.gh (Grasshopper 1.0.7)
# plug-ins: UrbanXTools

# ----
# 设计路网
number_slider = Slider(100, range=0..100)
curve = Curve([<curve referenced from the Rhino model> x219])
divlength = DivideLength(Curve=curve, Length=number_slider)  # -> Points, Tangents, Parameters
pt = Point(flatten(divlength.Points))
cullpt = CullDuplicates(Points=pt, Tolerance=0.1, CullMode=3)  # -> Points, Indices, Valence

# ----
# 建筑体块
brep = Brep([<brep referenced from the Rhino model> x188])

u_sustain_er = SA_ExposureRate(InputBreps=brep, InputPts=cullpt.Points, Nomalized=True, Radius=500, Segments=5)  # -> OutputLines, OutputExposureRates
preview = CustomPreview(Geometry=brep, Material=ColourSwatch(SwatchColor=RGBA(39, 115, 130, 133)))

# ----
# 5_建筑沿街底商空间曝光率可视化
data = Data(flatten(u_sustain_er.OutputExposureRates))
bounds = Bounds(Numbers=data)
deconstruct_domain = DeconstructDomain(Domain=bounds)  # -> Start, End
gradient = Gradient(
    LowerLimit=deconstruct_domain.Start,
    UpperLimit=deconstruct_domain.End,
    Parameter=data,
    stops=[0: RGB(234, 38, 0), 0.273: RGB(254, 244, 84), 0.618: RGB(173, 203, 249), 1: RGB(75, 107, 169)])
custom_preview = CustomPreview(Geometry=flatten(u_sustain_er.OutputLines), Material=gradient)
