# Grasshopper definition ExposureRates2D.gh (Grasshopper 1.0.7)
# plug-ins: UrbanXTools

# ----
# building breps
brep = Brep([<brep referenced from the Rhino model> x188])

preview = CustomPreview(Geometry=brep, Material=ColourSwatch(SwatchColor=RGBA(39, 115, 130, 133)))

# ----
# imported road networks
number_slider = Slider(500, range=0..1000)
curve = Curve([<curve referenced from the Rhino model> x219])

na_roadssplitter = NA_RoadsSplitter(OriginalCurves=curve)

divlength = DivideLength(Curve=na_roadssplitter, Length=number_slider)  # -> Points, Tangents, Parameters
pt = Point(flatten(divlength.Points))
cullpt = CullDuplicates(Points=pt, Tolerance=0.1, CullMode=1)  # -> Points, Indices, Valence

spatial_analysis_exposurerate2d = Spatial_Analysis_ExposureRate2D(InputBreps=brep, InputPts=cullpt.Points, Nomalized=True, Radius=500, Segments=Slider(10, range=0..10))  # -> OutputLines, OutputExposureRates

# ----
# visualization_the exposure rate in 2D layout
data = Data(flatten(spatial_analysis_exposurerate2d.OutputExposureRates))
bounds = Bounds(Numbers=data)
deconstruct_domain = DeconstructDomain(Domain=bounds)  # -> Start, End
gradient = Gradient(
    LowerLimit=deconstruct_domain.Start,
    UpperLimit=deconstruct_domain.End,
    Parameter=data,
    stops=[0: RGB(234, 38, 0), 0.273: RGB(254, 244, 84), 0.618: RGB(173, 203, 249), 1: RGB(75, 107, 169)])
custom_preview = CustomPreview(Geometry=flatten(spatial_analysis_exposurerate2d.OutputLines), Material=gradient)
